# Grasshopper definition 0A_con modify.gh (Grasshopper 1.0.7)
# plug-ins: KarambaIDEA

file_path = FilePath("C:\Users\NathanLuke\Desktop\Con Parameters Calculations\templateexport.contemp")
template_by_filepath = TemplateByFilepath(Path=file_path)
c_script = CSharpScript(x=".ideaCon")  # -> out, A; inputs x: String
# ---------- c_script: C# usings ----------
using System.IO;
# ---------- c_script: C# ----------
    string path = this.Component.OnPingDocument().FilePath;

    string directory = Path.GetDirectoryName(path);

    string[] files = Directory.GetFiles(directory, string.Concat('*',x));

    A = files;
# ---------- end c_script ----------
deconstruct_template = DeconstructTemplate(Template=template_by_filepath)
list_item = ListItem(List=c_script.A, Index=0, Wrap=True)  # -> Item, Item1
connection_results = ConnectionResults()  # -> Name, SummaryResults, PlateResults, WeldResults, BoltResults, AnchorResults, ConcreteBlockResults
file_path_2 = FilePath(list_item.Item)
panel = Panel(deconstruct_template)
set_param_value = SetParamValue(Parameter=deconstruct_template, Value="0.005")
# Add dontsave/save/save-as button?
# Add save as suffix option
boolean_toggle = BooleanToggle(True)
button = Button()
create_and_calculate_idea_file = CreateAndCalculateIDEAFile()  # -> SelectedJoint, Analysis, Plates, Bolts, Welds, Buckling, Summary
reference_connection = ReferenceConnection(Path=file_path_2)
modify_con_parameters = ModifyConParameters(Parameters=set_param_value)
create_idea_file = CreateIDEAFile()  # -> SelectedJoint, FilePaths
create_idea_file_2 = CreateIDEAFile()
calculate_connection = CalculateConnection(Connection=reference_connection, Modifications=modify_con_parameters, RunIDEA=boolean_toggle)
panel_3 = Panel(modify_con_parameters)
panel_4 = Panel("PP1a")
connection_results_2 = ConnectionResults(Connection=calculate_connection)  # -> Name, SummaryResults, PlateResults, WeldResults, BoltResults, AnchorResults, ConcreteBlockResults
deconstruct_item_result = DeconstructItemResult(ItemResult=connection_results_2.SummaryResults)  # -> Name, CheckStatus, UnityCheck, PlMaxStress, PlMaxStrain, Items, ItemId, CheckMsg
deconstruct_item_result_2 = DeconstructItemResult(ItemResult=connection_results_2.WeldResults)  # -> Name, CheckStatus, UnityCheck, PlMaxStress, PlMaxStrain, Items, ItemId, CheckMsg
panel_5 = Panel(deconstruct_item_result.CheckStatus)
panel_6 = Panel(deconstruct_item_result.UnityCheck)
panel_7 = Panel(deconstruct_item_result.Name)
panel_8 = Panel(deconstruct_item_result.CheckMsg)
panel_9 = Panel(deconstruct_item_result_2.Name)
panel_10 = Panel(deconstruct_item_result_2.UnityCheck)
